# Grasshopper definition cluster.gh (Grasshopper 0.9.76)

num = Number()
int = Integer()
int_2 = Integer()
int_3 = Integer()
int_4 = Integer()
int_5 = Integer(int)
int_6 = Integer(int_2)
int_7 = Integer(int_3)
int_8 = Integer(int_4)
num_2 = Number(num)
dom = ConstructDomain(DomainStart=expr("-x", num_2), DomainEnd=num_2)
random = Random(Range=dom, Number=int_5, Seed=int_6)
jitter = Jitter(List=random, Jitter=1, Seed=int_7)  # -> Values, Indices
jitter_2 = Jitter(List=random, Jitter=1, Seed=int_8)  # -> Values, Indices
pt = ConstructPoint(XCoordinate=random, YCoordinate=jitter.Values, ZCoordinate=0)
pt_2 = Point(pt)
