# Grasshopper definition 中钢表皮gh.gh (Grasshopper 0.9.76)
# plug-ins: LunchBox

hexgrid = Hexagonal(Plane=PlaneXY(0, 0, 0), Size=3, ExtentX=Slider(16, range=10..50), ExtentY=Slider(32, range=10..50))  # -> Cells, Points
intcrv = Interpolate(
    Vertices=[Point(4.955161169, 174.2301755, 0), Point(13.70567971, 134.6225653, 0), Point(3.573500348, 74.75059632, 0), Point(12.78457249, 7.970323284, 0), Point(27.52228792, -34.40060858, 0)],
    Degree=3,
    Periodic=False,
    KnotStyle=1)  # -> Curve, Length, Domain
intcrv_2 = Interpolate(
    Vertices=[Point(29.82505596, 174.6907291, 0), Point(26.60118071, 132.3197972, 0), Point(35.35169924, 73.3689355, 0), Point(37.19391367, 12.11530575, 0), Point(27.52228792, -22.42621479, 0)],
    Degree=3,
    Periodic=False,
    KnotStyle=1)  # -> Curve, Length, Domain
intcrv_3 = Interpolate(
    Vertices=[Point(50.08941467, 175.6118363, 0), Point(56.53716517, 132.3197972, 0), Point(48.70775385, 75.67170354, 0), Point(57.45827239, 14.41807378, 0), Point(62.98491567, -27.03175086, 0)],
    Degree=3,
    Periodic=False,
    KnotStyle=1)  # -> Curve, Length, Domain
crv = Curve([intcrv_3.Curve, intcrv_2.Curve, intcrv.Curve])
pull = PullPoint(Point=hexgrid.Points, Geometry=crv, ClosestOnly=True)  # -> ClosestPoint, Distance
multiplication = Multiplication(A=pull.Distance, B=Slider(0.13, range=0..1))
division = Division()
min = Minimum(A=multiplication, B="0.9")
scale = Scale(Geometry=hexgrid.Cells, Center=hexgrid.Points, Factor=min)  # -> Geometry, Transform
flatten = FlattenTree(Tree=scale.Geometry, Path="{0}")
boundary = BoundarySurfaces(Edges=[scale.Geometry, hexgrid.Cells])
join = BrepJoin(Breps=flatten(boundary))  # -> Breps, Closed
bbox = BoundingBox(Content=join.Breps, Plane=PlaneXY(0, 0, 0))  # -> Box, Box_2
wires = BrepWireframe(Brep=bbox.Box_2, Density=-1)
len = Length(Curve=wires)
join_2 = JoinCurves(Curves=wires, Preserve=False)
item = ListItem(List=len, Index=0, Wrap=True)
item_2 = ListItem(List=len, Index=1, Wrap=True)
boundary_2 = BoundarySurfaces(Edges=flatten([join_2, flatten]))
division_2 = Division(A=item, B=4)
rectangle = Rectangle(Plane=PlaneXY(0, 0, 0), XSize=division_2, YSize=division_2, Radius=0)  # -> Rectangle, Length
fillet = Fillet(Curve=rectangle.Rectangle, Radius=3)
Z = UnitZ(Factor=item_2)
extr = Extrude(Base=fillet, Direction=Z)
revsrf = ReverseSurfaceDirection(Surface=extr, ReverseOption=3)
trim = CopyTrim(Source=boundary_2, Target=revsrf)
