# Grasshopper definition 数据类型.gh (Grasshopper 0.9.76)

number_slider = Slider(0.25, range=0..1)
sqgrid = Square(Plane=PlaneXY(0, 0, 0), Size=1, ExtentX=5, ExtentY=5)  # -> Cells, Points
series = Series(Start=0, Step=1, Count=10)
explode = Explode(Curve=sqgrid.Cells, Recursive=True)  # -> Segments, Vertices
panel = Panel(sqgrid.Cells)
panel_2 = Panel(explode.Segments)
panel_3 = Panel(number_slider)
panel_4 = Panel(series)
viewer = ParamViewer(number_slider)
viewer_2 = ParamViewer(panel_2)
viewer_3 = ParamViewer(sqgrid.Cells)
viewer_4 = ParamViewer(series)
path_mapper = PathMapper(explode.Segments, source="{a;b;c;d}", target="{a;b;c}")
path_mapper_2 = PathMapper(series, source="{a;b}", target="{a}")
path_mapper_3 = PathMapper(sqgrid.Cells, source="{a;b;c}", target="{a;b}")
flatten = FlattenTree(Tree=viewer_2, Path="{0}")
viewer_5 = ParamViewer(flatten)
viewer_6 = ParamViewer(path_mapper_2)
viewer_7 = ParamViewer(path_mapper)
viewer_8 = ParamViewer(path_mapper_3)
