# Grasshopper definition 数据结构.gh (Grasshopper 0.9.76)

N = Step(1)
polygon = Polygon(Plane=PlaneXY(0, 0, 0), Radius=10, Segments=4, FilletRadius=0)  # -> Polygon, Length
series = Series(Start=0, Step=N, Count=Slider(50, range=0..50))
Z = UnitZ(Factor=series)
pi = Pi(Factor=expr("x/2", Slider(1, range=0..10)))
move = Move(Geometry=polygon.Polygon, Motion=Z)  # -> Geometry, Transform
dup = DuplicateData(Data=0, Number=10, Order=True)
range = Range(Domain=pi, Steps=Slider(30, range=0..30))
merge = Merge(Data1=dup, Data2=range)
area = Area(Geometry=move.Geometry)  # -> Area, Centroid
graph = GraphMapper(
    series,
    x0=0,
    x1=1,
    y0=0,
    y1=1,
    container_name="Sine",
    Equation_px=[0.01161835156, 0.5129562616],
    Equation_py=[0.4522413611, 0.9686792493])
rotate = Rotate(Geometry=move.Geometry, Angle=merge, Plane=area.Centroid)  # -> Geometry, Transform
scale_nu = ScaleNU(Geometry=rotate.Geometry, Plane=area.Centroid, ScaleX=graph, ScaleY=1, ScaleZ=1)  # -> Geometry, Transform
Z_2 = UnitZ(Factor=N)
boundary = BoundarySurfaces(Edges=scale_nu.Geometry)
extr = Extrude(Base=boundary, Direction=Z_2)
