# Grasshopper definition 曲面增加厚度.gh (Grasshopper 0.9.76)

crv = Curve(<curve referenced from the Rhino model>)
crv_2 = Curve(<curve referenced from the Rhino model>)
crv_3 = Curve(<curve referenced from the Rhino model>)
loft_opt = LoftOptions(Closed=False, Adjust=False, Rebuild=0, Refit=0, Type=0)
merge = Merge(Data1=crv, Data2=crv_2, Data3=crv_3)
loft = Loft(Curves=merge, Options=loft_opt)
offset = Offset(Surface=loft, Distance=1.5, Retrim=True)
debrep = DeconstructBrep(Brep=loft)  # -> Faces, Edges, Vertices
debrep_2 = DeconstructBrep(Brep=offset)  # -> Faces, Edges, Vertices
graft = GraftTree(Tree=debrep.Edges, IncludeEmptyLists=True, IncludeNullItems=True)
graft_2 = GraftTree(Tree=debrep_2.Edges, IncludeEmptyLists=True, IncludeNullItems=True)
loft_2 = Loft(
    Curves=[graft_2, graft],
    Options={Adjust=False, Closed=False, LoftEnds=0, LoftSimp=0, LoftType=0, Rebuild=10, Refit=0.01})
join = BrepJoin(Breps=flatten([loft_2, offset, loft]))  # -> Breps, Closed
