# Grasshopper definition 曲面细分与玻璃平板化.gh (Grasshopper 0.9.76)

number_slider = Slider(35, range=0..50)
N = Step(1)
polygon = Polygon(Plane=PlaneXY(0, 0, 0), Radius=5, Segments=4, FilletRadius=0)  # -> Polygon, Length
series = Series(Start=0, Step=N, Count=number_slider)
Z = UnitZ(Factor=series)
pi = Pi(Factor=expr("x/2", Slider(1, range=0..10)))
move = Move(Geometry=polygon.Polygon, Motion=Z)  # -> Geometry, Transform
range = Range(Domain=pi, Steps=expr("x-1", number_slider))
dup = DuplicateData(Data=0, Number=10, Order=True)
merge = Merge(Data1=dup, Data2=range)
area = Area(Geometry=move.Geometry)  # -> Area, Centroid
graph = GraphMapper(
    range,
    x0=0,
    x1=1,
    y0=0,
    y1=1,
    container_name="Sine",
    Equation_px=[0.01161835156, 0.5129562616],
    Equation_py=[0.4522413611, 0.9686792493])
rotate = Rotate(Geometry=move.Geometry, Angle=range, Plane=area.Centroid)  # -> Geometry, Transform
scale_nu = ScaleNU(Geometry=rotate.Geometry, Plane=area.Centroid, ScaleX=graph, ScaleY=1, ScaleZ=1)  # -> Geometry, Transform
Z_2 = UnitZ(Factor=N)
boundary = BoundarySurfaces(Edges=rotate.Geometry)
loft = Loft(Curves=rotate.Geometry, Options={Adjust=False, Closed=False, LoftEnds=0, LoftSimp=0, LoftType=0, Rebuild=10, Refit=0.01})
extr = Extrude(Base=boundary, Direction=Z_2)
debrep = DeconstructBrep(Brep=loft)  # -> Faces, Edges, Vertices
divide = DivideDomain²(Domain=debrep.Faces, UCount=expr("x-15", number_slider), VCount=10)
subsrf = Isotrim(Surface=graft(debrep.Faces), Domain=divide)
debrep_2 = DeconstructBrep(Brep=subsrf)  # -> Faces, Edges, Vertices
item = ListItem(List=debrep_2.Vertices, Index=0, Wrap=True)
item_2 = ListItem(List=debrep_2.Vertices, Index=1, Wrap=True)
item_3 = ListItem(List=debrep_2.Vertices, Index=2, Wrap=True)
item_4 = ListItem(List=debrep_2.Vertices, Index=3, Wrap=True)
srf4pt = _4PointSurface(CornerA=item, CornerB=item_2, CornerC=item_4)
srf4pt_2 = _4PointSurface(CornerA=item_2, CornerB=item_3, CornerC=item_4)
wires = BrepWireframe(Brep=srf4pt, Density=-1)
wires_2 = BrepWireframe(Brep=srf4pt_2, Density=-1)
join = JoinCurves(Curves=wires, Preserve=False)
join_2 = JoinCurves(Curves=wires_2, Preserve=False)
area_2 = Area(Geometry=srf4pt)  # -> Area, Centroid
area_3 = Area(Geometry=srf4pt_2)  # -> Area, Centroid
series_2 = Series(Start=0.01, Step=0.1, Count=10)
dup_2 = DuplicateData(Data=series_2, Number=80, Order=True)
jitter = Jitter(List=dup_2, Jitter=1, Seed=2)  # -> Values, Indices
scale = Scale(Geometry=join, Center=area_2.Centroid, Factor=graft(jitter.Values))  # -> Geometry, Transform
boundary_2 = BoundarySurfaces(Edges=[join, scale.Geometry])
