# Grasshopper definition 望京SOHO.gh (Grasshopper 0.9.76)

series = Series(Start=0, Step="3", Count="16")
series_2 = Series(Start=0, Step="3", Count="16")
pt = ConstructPoint(XCoordinate=0, YCoordinate=0, ZCoordinate=expr("x+1.5", series))
pt_2 = ConstructPoint(XCoordinate=0, YCoordinate=0, ZCoordinate=series_2)
xy = XYPlane(Origin=pt)
xy_2 = XYPlane(Origin=pt_2)
srf = Surface(<surface referenced from the Rhino model>)
srf_2 = Surface(<surface referenced from the Rhino model>)
sec = BrepPlane(Brep=srf, Plane=xy)  # -> Curves, Points
sec_2 = BrepPlane(Brep=srf_2, Plane=xy_2)  # -> Curves, Points
N = Count(10)
divide = DivideCurve(Curve=sec_2.Curves, Count=N, Kinks=False)  # -> Points, Tangents, Parameters
divide_2 = DivideCurve(Curve=sec.Curves, Count=N, Kinks=False)  # -> Points, Tangents, Parameters
crv = Curve(<curve referenced from the Rhino model>)
pull = PullPoint(Point=divide.Points, Geometry=crv, ClosestOnly=True)  # -> ClosestPoint, Distance
boundary = BoundarySurfaces(Edges=sec_2.Curves)
Z = UnitZ(Factor=0.1)
multiplication = Multiplication(A=pull.Distance, B=Slider(0.055, range=0..1))
min = Minimum(A=multiplication, B="0.7")
Z_2 = UnitZ(Factor=min)
Z_3 = UnitZ(Factor=expr("-x", min))
move = Move(Geometry=divide.Points, Motion=Z_2)  # -> Geometry, Transform
move_2 = Move(Geometry=divide_2.Points, Motion=Z_3)  # -> Geometry, Transform
intcrv = Interpolate(Vertices=move.Geometry, Degree=3, Periodic=True, KnotStyle=1)  # -> Curve, Length, Domain
intcrv_2 = Interpolate(Vertices=move_2.Geometry, Degree=3, Periodic=True, KnotStyle=1)  # -> Curve, Length, Domain
loft = Loft(
    Curves=[intcrv_2.Curve, intcrv.Curve],
    Options={Adjust=False, Closed=False, LoftEnds=0, LoftSimp=0, LoftType=0, Rebuild=10, Refit=0.01})
extr = Extrude(Base=boundary, Direction=Z)
