# Grasshopper definition 波纹面建模.gh (Grasshopper 0.9.76)

series = Series(Start=1, Step=1, Count=20)
pi = Pi(Factor=10)
series_2 = Series(Start=0, Step=1, Count=10)
range = Range(Domain=pi, Steps=40)
rev = ReverseList(List=series_2)
pt = ConstructPoint(XCoordinate=range, YCoordinate=0, ZCoordinate=expr("sin(x)", range))
cir = Circle(Plane=PlaneXY(0, 0, 0), Radius=series)
multiplication = Multiplication(A=rev, B=Slider(0.25, range=0..1))
intcrv = Interpolate(Vertices=pt, Degree=3, Periodic=False, KnotStyle=1)  # -> Curve, Length, Domain
dispatch = Dispatch(List=cir, DispatchPattern=[True, False])  # -> ListA, ListB
Z = UnitZ(Factor=multiplication)
revsrf = Revolution(Curve=intcrv.Curve, Axis=Line((0, 0, 0), (0, 0, 2)), Domain=Domain(0, 6.283185307))
move = Move(Geometry=dispatch.ListB, Motion=Z)  # -> Geometry, Transform
weave = Weave(Pattern=[0, 1], Stream0=dispatch.ListA, Stream1=move.Geometry, NullGaps=False)
loft = Loft(Curves=weave, Options={Adjust=False, Closed=False, LoftEnds=0, LoftSimp=0, LoftType=0, Rebuild=10, Refit=0.01})
