# Grasshopper definition 渐变空心模块矩阵.gh (Grasshopper 0.9.76)

number_slider = Slider(11, range=0..30)
number_slider_2 = Slider(16, range=0..30)
series = Series(Start=1, Step=1, Count=number_slider)
sqgrid = Square(Plane=PlaneXY(0, 0, 0), Size=1, ExtentX=number_slider, ExtentY=number_slider_2)  # -> Cells, Points
multiplication = Multiplication(A=series, B=Slider(0.081, range=0..1))
area = Area(Geometry=sqgrid.Cells)  # -> Area, Centroid
scale = Scale(Geometry=sqgrid.Cells, Center=area.Centroid, Factor=graft(multiplication))  # -> Geometry, Transform
flip = FlipMatrix(Data=sqgrid.Cells)
flip_2 = FlipMatrix(Data=scale.Geometry)
series_2 = Series(Start=1, Step=1, Count=number_slider_2)
area_2 = Area(Geometry=flip_2)  # -> Area, Centroid
multiplication_2 = Multiplication(A=series_2, B=Slider(0.055, range=0..1))
scale_2 = Scale(Geometry=flip_2, Center=area_2.Centroid, Factor=graft(multiplication_2))  # -> Geometry, Transform
series_3 = Series(Start=1, Step=1, Count=number_slider_2)
boundary = BoundarySurfaces(Edges=[scale_2.Geometry, flip])
multiplication_3 = Multiplication(A=series_3, B=Slider(0.055, range=0..1))
dup = DuplicateData(Data=multiplication_3, Number=Slider(11, range=0..20), Order=True)
jitter = Jitter(List=dup, Jitter=1, Seed=2)  # -> Values, Indices
Z = UnitZ(Factor=jitter.Values)
extr = Extrude(Base=flatten(boundary), Direction=Z)
