# Grasshopper definition 渐消曲面.gh (Grasshopper 0.9.76)

series = Series(Start=0, Step=Slider(8, range=0..10), Count=10)
cir = Circle(Plane=PlaneXY(0, 0, 0), Radius=5)
Z = UnitZ(Factor=series)
move = Move(Geometry=cir, Motion=Z)  # -> Geometry, Transform
divide = DivideCurve(Curve=move.Geometry, Count=Slider(8, range=0..10), Kinks=False)  # -> Points, Tangents, Parameters
pt = ConstructPoint(XCoordinate=0, YCoordinate=0, ZCoordinate=Z)
series_2 = Series(Start=Slider(0.25, range=0..1), Step=Slider(0.3, range=0..1), Count=10)
dispatch = Dispatch(List=divide.Points, DispatchPattern=[True, False])  # -> ListA, ListB
graft = GraftTree(Tree=series_2, IncludeEmptyLists=True, IncludeNullItems=True)
graft_2 = GraftTree(Tree=pt, IncludeEmptyLists=True, IncludeNullItems=True)
pt_2 = Point(dispatch.ListA)
vec2pt = Vector2Pt(PointA=pt_2, PointB=graft_2, Unitize=False)  # -> Vector, Length
amp = Amplitude(Vector=vec2pt.Vector, Amplitude=graft)
move_2 = Move(Geometry=pt_2, Motion=amp)  # -> Geometry, Transform
series_3 = Series(Start=Slider(0.25, range=0..1), Step=Slider(0.3, range=0..1), Count=10)
weave = Weave(Pattern=[0, 1], Stream0=move_2.Geometry, Stream1=dispatch.ListB, NullGaps=False)
graft_3 = GraftTree(Tree=series_3, IncludeEmptyLists=True, IncludeNullItems=True)
nurbs = NurbsCurve(Vertices=weave, Degree=2, Periodic=True)  # -> Curve, Length, Domain
area = Area(Geometry=nurbs.Curve)  # -> Area, Centroid
rotate = Rotate(Geometry=nurbs.Curve, Angle=graft_3, Plane=area.Centroid)  # -> Geometry, Transform
loft = Loft(
    Curves=flatten(rotate.Geometry),
    Options={Adjust=False, Closed=False, LoftEnds=0, LoftSimp=0, LoftType=0, Rebuild=10, Refit=0.01})
