# Grasshopper definition 螺线线.gh (Grasshopper 0.9.76)

C = Count(50)
series = Series(Start=1, Step=1, Count=C)
cir = Circle(Plane=PlaneXY(0, 0, 0), Radius=series)
divide = DivideCurve(Curve=cir, Count=40, Kinks=False)  # -> Points, Tangents, Parameters
shift = ShiftList(List=divide.Points, Shift=expr("-x", graft(series)), Wrap=True)
shift_2 = ShiftList(List=divide.Points, Shift=graft(series), Wrap=True)
flip = FlipMatrix(Data=[shift_2, shift])
intcrv = Interpolate(Vertices=flip, Degree=3, Periodic=False, KnotStyle=1)  # -> Curve, Length, Domain
